% Simulink data dictionary common.sldd

NMEA_GPRMB = Simulink.Bus()
  Status: string
  Error: double
  ErrorDirection: string
  OriginWaypointID: uint16
  DestinationWaypointID: uint16
  DestinationWaypointLatitudeDegree: uint16
  DestinationWaypointLatitudeMinute: double
  DestinationWaypointNS: string
  DestinationWaypointLongitudeDegree: uint16
  DestinationWaypointLongitudeMinute: double
  DestinationWaypointEW: string
  RangeToDestination: double
  TrueBearing: double
  Velocity: double
  ArrivalAlarm: string
  Checksum: string

NMEA_GPZDA = Simulink.Bus()
  CurrentTime: string
  Day: uint16
  Month: uint16
  Year: uint16
  LocalHours: int16
  LocalMinutes: uint16
  Checksum: string

NMEASentence = enum(DefaultValue="RMB")
  RMB = 0
  RMC = 1
  GSV = 2
  ZDA = 3
  VTG = 4
  GGA = 5
  GLL = 6
  GSA = 7

NMEA_GPGGA = Simulink.Bus()
  UTCFixTime: string
  LatitudeDegree: uint16, Unit="deg"
  LatitudeMinute: double
  LatitudeNS: string
  LongitudeDegree: uint16
  LongitudeMinute: double
  LongitudeEW: string
  FixQuality: Enum: NMEAFixQuality
  NumberOfSatellites: uint16
  HDOP: double
  Altitude: double, Unit="m"
  HeightGeoid: double, Unit="m"
  Checksum: string

NMEAFixQuality = enum(DefaultValue="Invalid")
  Invalid = 0
  GPS_fix_SPS = 1
  DGPS_fix = 2
  PPS_fix = 3
  RealTimeKinematic = 4
  FloatRTK = 5
  Estimated_deadreckoning = 6
  Manual = 7
  Simulation = 8

NMEA_GSV = Simulink.Bus()
  NumberOfSentences: uint8
  SentenceNumber: uint8
  SatellitesInView: uint16
  SatellitePRN: uint16
  Elevation: uint16, Unit="deg"
  Azimuth: uint16, Unit="deg"
  SNR: string
  Checksum: string

NMEA_VTG = Simulink.Bus()
  TrueTrackMade: double
  MagneticTrackMade: double
  GroundSpeed_k: double, Unit="kn"
  GroundSpeed: double, Unit="km/hr"
  SignalIntegrity: string
  Checksum: string

NMEA_GLL = Simulink.Bus()
  LatitudeDegree: uint16
  LatitudeMinute: double
  LatitudeNS: string
  LongitudeDegree: uint16
  LongitudeMinute: double
  LongitudeEW: string
  UTCFixTime: string
  DataActive: string
  SignalIntegrity: string
  Checksum: string

NMEA_GSA = Simulink.Bus()
  AutoSelection: string  % A (auto selection of 2D or 3D fix) or M (manual)
  Fix: Enum: NMEA3DFix
  SatellitePRN: uint16[12]
  PDOP: double
  HDOP: double
  VDOP: double
  Checksum: string

NMEA3DFix = enum(DefaultValue="NoFix")
  NoFix = 1
  Fix_2D = 2
  Fix_3D = 3

NMEA_GPRMC = Simulink.Bus()
  UTCFixTime: string
  Status: string
  LatitudeDegree: uint16
  LatitudeMinute: double
  LatitudeNS: string
  LongitudeDegree: uint16
  LongitudeMinute: double
  LongitudeEW: string
  GroundSpeed: double
  TrackAngle: double
  Date: string
  MagneticVariation: double
  MagneticVariationDirection: string
  SignalIntegrity: string
  Checksum: string